vi "Function.gvi"   [LabVIEW Platform Developer Preview 0.1.0]
panel controls:
  "Trigger": bool
panel indicators:
  "Send File": bool
  "Temp": f64
  "Buffer": f64
  "Files Sent": f64
  "Available Memory": f64
  "Available Disk": f64
uses:
  Component::Read Tag (Double).gvi
  Component::Update Tag (Double).gvi
diagram:
  while {
    Wait(time to wait=1000)
    w1 = ["josh-9068.available_disk", "josh-9068.available_memory", "josh-9068.files_sent", "josh-9068.buffer", "josh-9068.ai.0"]
    for (iteration -> i1) {
      w2 = each element of w1
      case (i1) {
        frame 0, Default {
          call "Read Tag (Double).gvi"(Server="ec2-52-90-2-25.compute-1.amazonaws.com", Tag=w2) -> (Value=w3)
          $"Available Disk" <- w3
        }
        frame 1 {
          call "Read Tag (Double).gvi"(Server="ec2-52-90-2-25.compute-1.amazonaws.com", Tag=w2) -> (Value=w4)
          $"Available Memory" <- w4
        }
        frame 2 {
          call "Read Tag (Double).gvi"(Server="ec2-52-90-2-25.compute-1.amazonaws.com", Tag=w2) -> (Value=w5)
          $"Files Sent" <- w5
        }
        frame 3 {
          call "Read Tag (Double).gvi"(Server="ec2-52-90-2-25.compute-1.amazonaws.com", Tag=w2) -> (Value=w6)
          $Buffer <- w6
        }
        frame 4 {
          call "Read Tag (Double).gvi"(Server="ec2-52-90-2-25.compute-1.amazonaws.com", Tag="josh-9068.ai.1")
          call "Read Tag (Double).gvi"(Server="ec2-52-90-2-25.compute-1.amazonaws.com", Tag=w2) -> (Value=w7)
          $Temp <- w7
        }
      }
    }
    stop if FALSE
  }
  while {
    Wait(time to wait=50)
    case ($Trigger) {
      frame False, Default {
        $"Send File" <- FALSE
      }
      frame True {
        Wait(time to wait=500)
        $"Send File" <- TRUE
        call "Read Tag (Double).gvi"(Server="ec2-52-90-2-25.compute-1.amazonaws.com", Tag="josh-9068.send_file") -> (Value=w8)
        Increment(x=w8) -> w9
        call "Update Tag (Double).gvi"(Server="ec2-52-90-2-25.compute-1.amazonaws.com", Tag="josh-9068.send_file", Tag Value=w9)
      }
    }
    stop if FALSE
  }
